# Grasshopper definition Polyline_Loader.gh (Grasshopper 1.0.7)

file_path = FilePath("C:\Users\GeorgeAdamon\Documents\GitHub\dfpi\workshops\unity\2021_quantum_magick\Assets\StreamingAssets\Recorded Polylines\Polyline_105-Vertices_2021-01-30-02-31-59.csv")
read_file = ReadFile(File=file_path, PerLineParse=True)
deconstruct = Deconstruct(Point=read_file)  # -> XComponent, YComponent, ZComponent
construct_point = ConstructPoint(XCoordinate=deconstruct.XComponent, YCoordinate=deconstruct.ZComponent, ZCoordinate=deconstruct.YComponent)
interpolate = Interpolate(Vertices=construct_point, Degree=3, Periodic=False, KnotStyle=1)  # -> Curve, Length, Domain
